# Grasshopper definition LatticeCalculation.ghx (Grasshopper 0.9.76)
# plug-ins: Python Interpreter, PTComponentLibrary

crv = Curve([<curve referenced from the Rhino model> x6])
number_slider = Slider(0.25, range=0..1)
loft = Loft(Curves=crv, Options={Adjust=True, Closed=False, LoftEnds=0, LoftSimp=1, LoftType=1, Rebuild=25, Refit=0.1})
plfit = PlaneFit(Points=[Point(264, 996.6812134, 550.6173096), Point(423, 996.6812134, 550.6173096), Point(423, 841.1177368, 706.1807861)])  # -> Plane, Deviation
plfit_2 = PlaneFit(Points=[Point(34, 1123, 739), Point(168.095665, 1180.922302, 739), Point(187.3769073, 1091.12793, 739)])  # -> Plane, Deviation
offset = Offset(Surface=loft, Distance=20, Retrim=True)
number_slider_2 = Slider(11.312, range=5..30)
sec = BrepPlane(Brep=loft, Plane=plfit_2.Plane)  # -> Curves, Points
sec_2 = BrepPlane(Brep=loft, Plane=plfit.Plane)  # -> Curves, Points
sec_3 = BrepPlane(Brep=offset, Plane=plfit_2.Plane)  # -> Curves, Points
sec_4 = BrepPlane(Brep=offset, Plane=plfit.Plane)  # -> Curves, Points
int = Integer(3)
ptdividenum = DivideNumber(Curve=sec_4.Curves, Number=number_slider_2)
ptdividenum_2 = DivideNumber(Curve=sec_3.Curves, Number=number_slider_2)
ptdividenum_3 = DivideNumber(Curve=sec_2.Curves, Number=number_slider_2)
ptdividenum_4 = DivideNumber(Curve=sec.Curves, Number=int)
ptdividenum_5 = DivideNumber(Curve=sec.Curves, Number=number_slider_2)
ptdividenum_6 = DivideNumber(Curve=sec_2.Curves, Number=int)
geodesic = Geodesic(Surface=offset, Start=ptdividenum, End=ptdividenum_2)
geodesic_2 = Geodesic(Surface=loft, Start=ptdividenum_3, End=ptdividenum_5)
geodesic_3 = Geodesic(Surface=loft, Start=ptdividenum_4, End=ptdividenum_6)
divide = DivideCurve(Curve=geodesic_3, Count=Slider(8.9, range=5..17), Kinks=False)  # -> Points, Tangents, Parameters
flip = FlipMatrix(Data=divide.Points)
plfit_3 = PlaneFit(Points=flip)  # -> Plane, Deviation
sec_5 = BrepPlane(Brep=loft, Plane=plfit_3.Plane)  # -> Curves, Points
offset_2 = Offset(Curve=sec_5.Curves, Distance=10, Plane=plfit_3.Plane, Corners=1)
rulesrf = RuledSurface(CurveA=sec_5.Curves, CurveB=offset_2)
edgesrf = EdgeSurface(CurveA=geodesic, CurveB=geodesic_2)
python = PythonScript(x=edgesrf, y=rulesrf)  # -> out, a
# ---------- python: Python ----------
import rhinoscriptsyntax as rs
import scriptcontext

print str(x)
print str(y)

brep = rs.coercebrep(x, True)
y = rs.coercebrep(y, True)

cutter = rs.OffsetSurface(y, 1.5, None, True, True)
cutter = rs.coercebrep(cutter, True)

tolerance = 0.5
pieces = brep.Split(cutter, tolerance)
newBrep = pieces[0]
newBrep = scriptcontext.doc.Objects.AddBrep(newBrep)
rs.DeleteObject(x)
a = newBrep
# ---------- end python ----------
